# Grasshopper definition Bromelia Pot.gh (Grasshopper 1.0.7)
# plug-ins: Flexibility

# ---- group: RH_IN: Total Diameter
diameter = Slider(5.499, range=3..7)

# ----
conv_mm = Multiplication(A=diameter, B=25.4)

# ---- group: RH_IN:Height
height = Slider(4.043, range=3..7)

# ---- group: RH_IN: Water Catcher Height
number_slider = Slider(0.8, range=0.2..0.8)

# ---- group: RH_IN: Fronds
number_slider_2 = Slider(11, range=3..30)

# ---- group: RH_IN:Top Scale
scale_top = Slider(0.507, range=0..1)

# ---- group: RH_IN: Middle Scale
scale_mid = Slider(0.655, range=0..1)

# ---- group: RH_IN: Bottom Scale
scale_btm = Slider(1, range=0..1)

# ----
division = Division(A=conv_mm, B=2)
conv_mm_2 = Multiplication(A=height, B=25.4)
multiplication = Multiplication(A=division, B=scale_top)
multiplication_2 = Multiplication(A=division, B=scale_mid)
multiplication_3 = Multiplication(A=division, B=scale_btm)
Z = UnitZ(Factor=1)
pt = Point(Point(0, 0, 0))
line = LineSDL(Start=pt, Direction=Z, Length=expr("x-10", conv_mm_2))
num = Number([0, 20, 0.5, 1])
eval = EvaluateLength(Curve=line, Length=num, Normalized=[False, False, True, True])  # -> Point, Tangent, Parameter
item = ListItem(List=eval.Point, Index=0, Wrap=True)  # -> Item, Item1, Item2, Item3
ln = Line(StartPoint=item.Item, EndPoint=item.Item2)
eval_2 = EvaluateCurve(Curve=ln, Parameter=number_slider)  # -> Point, Tangent, Angle
vec2pt = Vector2Pt(PointA=item.Item, PointB=eval_2.Point, Unitize=False)  # -> Vector, Length
circle = CircleCNR(Center=item.Item, Normal=Vector(0, 0, 1), Radius=15)
circle_2 = CircleCNR(Center=item.Item, Normal=Vector(0, 0, 1), Radius=expr("x-5", multiplication_3))
circle_3 = CircleCNR(Center=item.Item2, Normal=Vector(0, 0, 1), Radius=multiplication_2)
circle_4 = CircleCNR(Center=item.Item3, Normal=Vector(0, 0, 1), Radius=multiplication)
divide = DivideCurve(Curve=circle_4, Count=expr("x*1.5", number_slider_2), Kinks=False)  # -> Points, Tangents, Parameters
divide_2 = DivideCurve(Curve=circle, Count=expr("x", number_slider_2), Kinks=False)  # -> simplify(Points), Tangents, Parameters
shift = ShiftList(List=divide.Points, Shift=1, Wrap=True)
shatter = Shatter(Curve=simplify(graft(circle)), Parameters=divide_2.Parameters)  # -> simplify(Segments)
shatter_2 = Shatter(Curve=simplify(graft(circle_4)), Parameters=divide.Parameters)  # -> simplify(Segments)
division_2 = Division(A=6.283185307, B=number_slider_2)
flip = FlipCurve(Curve=shatter)  # -> Curve, Flag
item_2 = ListItem(List=shatter_2, Index=0, Wrap=True)  # -> Item, Item1
series = Series(Start=0, Step=division_2, Count=number_slider_2)
division_3 = Division(A=6.283185307, B=number_slider_2)
rotate = Rotate(Geometry=item_2.Item1, Angle=series, Plane=PlaneXY(0, 0, 0))  # -> Geometry, Transform
item_3 = ListItem(List=flip.Curve, Index=0, Wrap=True)
series_2 = Series(Start=0, Step=division_3, Count=number_slider_2)
curvepoint = PointOnCurve(rotate.Geometry, parameter=0.732)
rotate_2 = Rotate(Geometry=item_3, Angle=series_2, Plane=PlaneXY(0, 0, 0))  # -> Geometry, Transform
end = EndPoints(Curve=rotate.Geometry)  # -> Start, End
Z_2 = UnitZ(Factor=5)
move = Move(Geometry=curvepoint, Motion=Z_2)  # -> flatten(Geometry), Transform
shift_2 = ShiftList(List=rotate_2.Geometry, Shift=expr("x/2", number_slider_2), Wrap=True)
divide_3 = DivideCurve(Curve=circle_3, Count=expr("x/2", number_slider_2), Kinks=False)  # -> simplify(Points), Tangents, Parameters
weave = Weave(Pattern=[0, 1, 2], Stream0=end.Start, Stream1=move.Geometry, Stream2=end.End, NullGaps=False)
shatter_3 = Shatter(Curve=simplify(graft(circle_3)), Parameters=divide_3.Parameters)  # -> simplify(Segments)
divide_4 = DivideCurve(Curve=circle_2, Count=expr("x/2", number_slider_2), Kinks=False)  # -> simplify(Points), Tangents, Parameters
partition = PartitionList(List=weave, Size=3)
shatter_4 = Shatter(Curve=simplify(graft(circle_2)), Parameters=divide_4.Parameters)  # -> simplify(Segments)
item_4 = ListItem(List=shatter_3, Index=0, Wrap=True)
intcrv = Interpolate(Vertices=partition, Degree=3, Periodic=False, KnotStyle=1)  # -> Curve, Length, Domain
multiplication_4 = Multiplication(A=3.141592654, B=Slider(0.376, range=0..1))
item_5 = ListItem(List=shatter_4, Index=0, Wrap=True)
division_4 = Division(A=multiplication_4, B=number_slider_2)
end_2 = EndPoints(Curve=item_4)  # -> Start, End
multiplication_5 = Multiplication(A=3.141592654, B=Slider(1, range=0..1))
rotate_3 = Rotate(Geometry=item_4, Angle=division_4, Plane=end_2.Start)  # -> Geometry, Transform
end_3 = EndPoints(Curve=item_5)  # -> Start, End
division_5 = Division(A=multiplication_5, B=number_slider_2)
rotate_4 = Rotate(Geometry=item_5, Angle=division_5, Plane=end_3.Start)  # -> Geometry, Transform
division_6 = Division(A=6.283185307, B=number_slider_2)
series_3 = Series(Start=0, Step=division_6, Count=number_slider_2)
rotate_5 = Rotate(Geometry=rotate_4.Geometry, Angle=series_3, Plane=PlaneXY(0, 0, 0))  # -> Geometry, Transform
divide_5 = DivideCurve(Curve=rotate_5.Geometry, Count=6, Kinks=False)  # -> Points, Tangents, Parameters
item_6 = ListItem(List=divide_5.Points, Index=0, Wrap=True)
vec2pt_2 = Vector2Pt(PointA=pt, PointB=item_6, Unitize=False)  # -> Vector, Length
move_2 = Move(Geometry=item_6, Motion=vec2pt.Vector)  # -> Geometry, Transform
amp = Amplitude(Vector=vec2pt_2.Vector, Amplitude=5)
move_3 = Move(Geometry=move_2.Geometry, Motion=amp)  # -> Geometry, Transform
division_7 = Division(A=6.283185307, B=number_slider_2)
series_4 = Series(Start=0, Step=division_7, Count=number_slider_2)
replace = ReplaceItems(List=divide_5.Points, Item=move_3.Geometry, Indices=0, Wrap=False)
rotate_6 = Rotate(Geometry=rotate_3.Geometry, Angle=series_4, Plane=PlaneXY(0, 0, 0))  # -> Geometry, Transform
nurbs = NurbsCurve(Vertices=replace, Degree=3, Periodic=False)  # -> flatten(Curve), Length, Domain
shift_3 = ShiftList(List=rotate_6.Geometry, Shift=1, Wrap=True)
shift_4 = ShiftList(List=nurbs.Curve, Shift=1, Wrap=True)
mcx = MultipleCurves(Curves=[rotate_6.Geometry, shift_3])  # -> Points, IndexA, IndexB, simplify(ParamA), ParamB
mcx_2 = MultipleCurves(Curves=[nurbs.Curve, shift_4])  # -> Points, IndexA, IndexB, simplify(ParamA), ParamB
branch = TreeBranch(Tree=mcx.ParamA, Path="{0}", MaintainPaths=True)
branch_2 = TreeBranch(Tree=mcx_2.ParamA, Path="{0}", MaintainPaths=True)
shatter_5 = Shatter(Curve=rotate_6.Geometry, Parameters=branch)
shatter_6 = Shatter(Curve=nurbs.Curve, Parameters=branch_2)
item_7 = ListItem(List=shatter_5, Index=0, Wrap=True)  # -> Item, Item1
item_8 = ListItem(List=shatter_6, Index=0, Wrap=True)  # -> Item, Item1
join = JoinCurves(Curves=[item_7.Item, item_7.Item1], Preserve=False)  # -> flatten(Curves)
join_2 = JoinCurves(Curves=[item_8.Item, item_8.Item1], Preserve=False)  # -> flatten(Curves)
lng = ListLength(List=join_2)
lng_2 = ListLength(List=join)
larger = LargerThan(FirstNumber=lng, SecondNumber=1)  # -> LargerThan, OrEqualTo
larger_2 = LargerThan(FirstNumber=lng_2, SecondNumber=1)  # -> LargerThan, OrEqualTo
filter = StreamFilter(Gate=larger.LargerThan, Stream0=nurbs.Curve, Stream1=join_2)
filter_2 = StreamFilter(Gate=larger_2.LargerThan, Stream0=rotate_6.Geometry, Stream1=join)
shift_5 = ShiftList(List=filter, Shift=-1, Wrap=True)
ext = ExtendCurve(Curve=filter_2, Type=0, Start=0, End=-5)
weave_2 = Weave(Pattern=[0, 1, 2, 3], Stream0=shift_2, Stream1=shift_5, Stream2=ext, Stream3=flatten(intcrv.Curve), NullGaps=False)
partition_2 = PartitionList(List=weave_2, Size=4)  # -> simplify(Chunks)
loft = Loft(Curves=partition_2, Options={Adjust=False, Closed=False, LoftEnds=0, LoftSimp=0, LoftType=0, Rebuild=10, Refit=0.01})  # -> flatten(Loft)
mesh = MeshBrep(
    Brep=loft,
    Settings={GridMaxCount=0, GridMinCount=16, JaggedSeams=False, MaxEdgeLength=0, MinEdgeLength=0.0001, MinTolerance=0, Refine=True, RefineAngle=0, RelativeTolerance=0.65, SimplePlanes=True, Tolerance=0})

# ---- group: RH_OUT:Bromelia
offset_mesh = OffsetMesh(Mesh=mesh, Distance=-2, Vector=Vector(0, 0, 0), Solid=True, BothSides=False)  # -> flatten(OffsetMesh)
