# Grasshopper definition Pangolin Floor Lamp.gh (Grasshopper 1.0.7)
# plug-ins: LunchBox, Flexibility

# ---- group: RH_IN:Top Scale
top_scale = Slider(1, range=0.2..1)

# ---- group: RH_IN:Bottom Scale
bottom_scale = Slider(1, range=0.2..1)

# ---- group: RH_IN:Middle Scale
# One of these must equal 1
middle_scale = Slider(1, range=0.2..1)

# ---- group: RH_IN:Gap
gap = Slider(2.336, range=1..3)

# ---- group: RH_IN:Diameter
diameter = Slider(12, range=6..24)

# ---- group: RH_IN:Height
height = Slider(16, range=6..16)

# ----
pt = Point(Point(0, 0, 0))
convert_mm = Multiplication(A=gap, B=25.4)
convert_mm_2 = Multiplication(A=height, B=25.4)
convert_mm_3 = Multiplication(A=diameter, B=25.4)
division = Division(A=convert_mm_3, B=2)
division_2 = Division(A=convert_mm_2, B=2)
neg = Negative(Value=division_2)
Z = UnitZ(Factor=[division_2, neg])
multiplication = Multiplication(A=division, B=top_scale)
multiplication_2 = Multiplication(A=division, B=middle_scale)
multiplication_3 = Multiplication(A=division, B=bottom_scale)
move = Move(Geometry=pt, Motion=Z)  # -> Geometry, Transform
item = ListItem(List=move.Geometry, Index=0, Wrap=True)  # -> Item, Item1
merge = Merge(Data1=multiplication, Data2=multiplication_2, Data3=multiplication_3)
merge_2 = Merge(Data1=item.Item, Data2=pt, Data3=item.Item1)
circle = CircleCNR(Center=merge_2, Normal=Vector(0, 0, 1), Radius=merge)
len = Length(Curve=circle)
sort = SortList(Keys=len)  # -> reverse(Keys), ValuesA
item_2 = ListItem(List=sort.Keys, Index=0, Wrap=True)
division_3 = Division(A=item_2, B=180)
num = Number(3)
expression = Expression(x=division_3, y=num, Expression="y*Round(x/y)")
divide = DivideCurve(Curve=circle, Count=expression, Kinks=False)  # -> Points, Tangents, Parameters
vec2pt = Vector2Pt(PointA=divide.Points, PointB=graft(merge_2), Unitize=False)  # -> Vector, Length
amp = Amplitude(Vector=vec2pt.Vector, Amplitude=convert_mm)
move_2 = Move(Geometry=divide.Points, Motion=amp)  # -> Geometry, Transform
flip = FlipMatrix(Data=move_2.Geometry)  # -> simplify(Data)
flip_2 = FlipMatrix(Data=divide.Points)  # -> simplify(Data)
intcrv = Interpolate(Vertices=flip, Degree=3, Periodic=False, KnotStyle=1)  # -> flatten(Curve), Length, Domain
intcrv_2 = Interpolate(Vertices=flip_2, Degree=3, Periodic=False, KnotStyle=1)  # -> flatten(Curve), Length, Domain
rotate = Rotate(Geometry=intcrv.Curve, Angle=0.15, Plane=pt)  # -> Geometry, Transform
shift = ShiftList(List=rotate.Geometry, Shift=1, Wrap=True)
weave = Weave(Pattern=[0, 1], Stream0=intcrv_2.Curve, Stream1=shift, NullGaps=False)
partition = PartitionList(List=weave, Size=2)
loft = Loft(Curves=partition, Options={Adjust=False, Closed=False, LoftEnds=0, LoftSimp=0, LoftType=0, Rebuild=10, Refit=0.01})
trib = TrianglePanelsB(Surface=loft, UDivisions=1, VDivisions=5)
cull_i = CullIndex(List=trib, Indices=[0, 5], Wrap=True)  # -> simplify(List)

# ---- group: RH_IN:Coverage
number_slider = Slider(0.75, range=0.5..0.9)

# ----
area = Area(Geometry=cull_i)  # -> Area, Centroid
number_slider_2 = Slider(2, range=0..10)
scale = Scale(Geometry=flatten(cull_i), Center=flatten(area.Centroid), Factor=number_slider)  # -> Geometry, Transform
explode = Explode(Curve=scale.Geometry, Recursive=True)  # -> Segments, Vertices
addition = Addition(A=number_slider_2, B=1)
divide_2 = DivideCurve(Curve=explode.Segments, Count=number_slider_2, Kinks=False)  # -> simplify(Points), Tangents, Parameters
multiplication_4 = Multiplication(A=addition, B=3)
partition_2 = PartitionList(List=flatten(divide_2.Points), Size=multiplication_4)
cullpt = CullDuplicates(Points=partition_2, Tolerance=0.1, CullMode=3)  # -> Points, Indices, Valence
flatten = FlattenTree(Tree=area.Centroid, Path="{0}")

# ---- group: RH_IN:Bumpout
number_slider_3 = Slider(5, range=0..10)

# ----
vec2pt_2 = Vector2Pt(PointA=pt, PointB=flatten, Unitize=False)  # -> Vector, Length
multiplication_5 = Multiplication(A=number_slider_3, B=0.01)
subtraction = Subtraction(A=400, B=vec2pt_2.Length)
multiplication_6 = Multiplication(A=subtraction, B=multiplication_5)
nurbs = NurbsCurve(Vertices=cullpt.Points, Degree=3, Periodic=True)  # -> simplify(Curve), Length, Domain
amp_2 = Amplitude(Vector=vec2pt_2.Vector, Amplitude=multiplication_6)
divide_3 = DivideCurve(Curve=nurbs.Curve, Count=3, Kinks=False)  # -> simplify(Points), Tangents, Parameters
move_3 = Move(Geometry=flatten, Motion=amp_2)  # -> simplify(graft(Geometry)), Transform
ln = Line(StartPoint=divide_3.Points, EndPoint=move_3.Geometry)
circle_2 = CircleCNR(Center=move_3.Geometry, Normal=graft(vec2pt_2.Vector), Radius=10)  # -> simplify(Circle)
netsurf = NetworkSurface(CurvesU=[nurbs.Curve, circle_2], CurvesV=ln, Continuity=3)  # -> flatten(Surface)
pipe = Pipe(Curve=nurbs.Curve, Radius=2.344867, Caps=0)
mesh_uv = MeshSurface(Surface=pipe, UCount=30, VCount=5, Overhang=True, Equalize=False)  # -> simplify(Mesh)
custom_mesh_settings = SettingsCustom(
    StitchSeams=True,
    SimplePlanes=True,
    Refine=True,
    MinCount=16,
    MaxCount=400,
    AspectRatio=20,
    MaxDistance=0,
    MaxAngle=20,
    MinEdge=15,
    MaxEdge=0)
mesh = MeshBrep(Brep=netsurf, Settings=custom_mesh_settings)  # -> graft(Mesh)
gate = StreamGate(Stream=nurbs.Curve, Gate=Toggle(False))  # -> Target0, Target1
mjoin = MeshJoin(Meshes=mesh)

# ---- group: RH_OUT:Floor_Leafs
python = GhPythonScript(x=mesh)  # -> a; inputs x: Mesh
# ---------- python: Python ----------
import json
import Rhino.Geometry as rg

try:
    meshes = x if isinstance(x, list) else [x]
    
    all_verts = []
    all_faces = []
    vert_offset = 0
    
    for mesh in meshes:
        if mesh is None or not hasattr(mesh, 'Vertices'):
            continue
        if mesh.Vertices.Count == 0 or mesh.Faces.Count == 0:
            continue
        
        mesh.Faces.ConvertQuadsToTriangles()
        
        for v in mesh.Vertices:
            all_verts.append([float(v.X), float(v.Y), float(v.Z)])
        
        for f in mesh.Faces:
            all_faces.append([int(f.A) + vert_offset,
                              int(f.B) + vert_offset,
                              int(f.C) + vert_offset])
        
        vert_offset += mesh.Vertices.Count
    
    a = json.dumps({"v": all_verts, "f": all_faces})  # indented inside try

except Exception as e:
    a = json.dumps({"v": [], "f": [], "error": str(e)})
# ---------- end python ----------

# ----
bounding_box = BoundingBox(Geometry=mesh, Plane=PlaneXY(0, 0, 0), Union=True, Index=4, Step=100, Axis=0, Method=False, Min=False, UseParallel=False)  # -> BBx, CBx
divide_4 = DivideCurve(Curve=gate.Target0, Count=3, Kinks=False)  # -> Points, Tangents, Parameters
boxprop = BoxProperties(Box=bounding_box.BBx)  # -> Center, Diagonal, Area, Volume, Degeneracy
panel = Panel(boxprop.Diagonal)
