# Grasshopper definition Pangolin Pendant Leafs.gh (Grasshopper 1.0.7)
# plug-ins: LunchBox, Kangaroo2 Components, Flexibility

# ---- group: RH_IN:Gap
gap = Slider(3, range=1..3)

# ---- group: RH_IN:Height
height = Slider(15, range=10..18)

# ---- group: RH_IN:Diameter
diameter = Slider(16, range=0..24)

# ----
center_of_bulbpt = Point(Point(0, 0, 0))

# ---- group: RH_IN:Flip
flip_direction = BooleanToggle(True)

# ---- group: RH_IN: TPDIA
top_diameter = Slider(0.475, range=0..1)

# ---- group: RH_IN:BTMDIA
bottom_diameter = Slider(0.843, range=0..1)

# ----
in_to_mm = Multiplication(A=gap, B=25.4)
in_to_mm_2 = Multiplication(A=height, B=25.4)
in_to_mm_3 = Multiplication(A=diameter, B=25.4)
num = Number(3)
divide_by_2 = Division(A=in_to_mm_2, B=2)
divide_by_2_2 = Division(A=in_to_mm_3, B=2)
circle = CircleCNR(Center=center_of_bulbpt, Normal=Vector(0, 0, 1), Radius=divide_by_2_2)
len = Length(Curve=circle)
division = Division(A=len, B=180)
expression = Expression(x=division, y=num, Expression="y*Round(x/y)")
division_2 = Division(A=360, B=expression)
addition = Addition(A=division_2, B=5)
rad = Radians(Degrees=addition)
rad_2 = Radians(Degrees=division_2)
Z = UnitZ(Factor=divide_by_2)
neg = Negative(Value=Z)
phi = GoldenRatio(Factor=1)
series = Series(Start=-1, Step=-1, Count=3)
series_2 = Series(Start=0, Step=rad_2, Count=expr("x", expression))
move = Move(Geometry=center_of_bulbpt, Motion=[Z, neg])  # -> Geometry, Transform
pow = Power(A=phi, B=series)
ins = InsertItems(List=reverse(pow), Item=[0, 1], Indices=[0, 3], Wrap=False)  # -> reverse(List)
item = ListItem(List=move.Geometry, Index=0, Wrap=True)
item_2 = ListItem(List=move.Geometry, Index=1, Wrap=True)
rev = ReverseList(List=ins)
filter = StreamFilter(Gate=flip_direction, Stream0=ins, Stream1=rev)
merge = Merge(Data1=item_2, Data2=center_of_bulbpt, Data3=item)
arc = Arc(Plane=merge, Radius=divide_by_2_2, Angle=rad)  # -> Arc, Length
divide = DivideCurve(Curve=arc.Arc, Count=4, Kinks=False)  # -> Points, Tangents, Parameters
vec2pt = Vector2Pt(PointA=divide.Points, PointB=graft(merge), Unitize=False)  # -> Vector, Length
line = LineSDL(Start=divide.Points, Direction=vec2pt.Vector, Length=in_to_mm)
eval = EvaluateCurve(Curve=line, Parameter=filter)  # -> Point, Tangent, Angle
viewer = ParamViewer(eval.Point)
item_3 = ListItem(List=viewer, Index=0, Wrap=True)  # -> Item, Item1, Item2
branch = TreeBranch(Tree=eval.Point, Path=item_3.Item, MaintainPaths=True)
branch_2 = TreeBranch(Tree=eval.Point, Path=item_3.Item2, MaintainPaths=True)
branch_3 = TreeBranch(Tree=eval.Point, Path=item_3.Item1, MaintainPaths=True)
scale = Scale(Geometry=branch, Center=item_2, Factor=bottom_diameter)  # -> Geometry, Transform
scale_2 = Scale(Geometry=branch_2, Center=item, Factor=top_diameter)  # -> Geometry, Transform
scale_3 = Scale(Geometry=branch_3, Center=item, Factor=Slider(1, range=0..1))  # -> Geometry, Transform
arc_2 = Arc3Pt(PointA=scale_2.Geometry, PointB=scale_3.Geometry, PointC=scale.Geometry)  # -> Arc, Plane, Radius
loft = Loft(Curves=arc_2.Arc, Options={Adjust=False, Closed=False, LoftEnds=0, LoftSimp=0, LoftType=0, Rebuild=10, Refit=0.01})
rotate = Rotate(Geometry=loft, Angle=series_2, Plane=PlaneXY(0, 0, 0))  # -> simplify(Geometry), Transform
# ADD TRI B AND CULL TO SEE IF STILL WORKS
trib = TrianglePanelsB(Surface=rotate.Geometry, UDivisions=1, VDivisions=5)
cull_i = CullIndex(List=trib, Indices=[0, 5], Wrap=True)  # -> simplify(List)

# ---- group: RH_IN:Coverage
number_slider = Slider(0.9, range=0.5..0.9)

# ----
area = Area(Geometry=cull_i)  # -> Area, Centroid
mesh = MeshBrep(
    Brep=trib,
    Settings={GridMaxCount=0, GridMinCount=16, JaggedSeams=False, MaxEdgeLength=0, MinEdgeLength=0.0001, MinTolerance=0, Refine=True, RefineAngle=0, RelativeTolerance=0.65, SimplePlanes=True, Tolerance=0})
mjoin = MeshJoin(Meshes=flatten(mesh))
number_slider_2 = Slider(2, range=0..10)
scale_4 = Scale(Geometry=flatten(cull_i), Center=flatten(area.Centroid), Factor=number_slider)  # -> Geometry, Transform
explode = Explode(Curve=scale_4.Geometry, Recursive=True)  # -> Segments, Vertices
addition_2 = Addition(A=number_slider_2, B=1)

# ---- group: RH_OUT:Geometry
python = GhPythonScript(x=mjoin)  # -> out, a; inputs x: Mesh
# ---------- python: Python ----------
import json
import Rhino.Geometry as rg

mesh = x

verts = []
for v in mesh.Vertices:
    verts.append([float(v.X), float(v.Y), float(v.Z)])

face_list = []
for f in mesh.Faces:
    if f.IsQuad:
        face_list.append([int(f.A), int(f.B), int(f.C), int(f.D)])
    else:
        face_list.append([int(f.A), int(f.B), int(f.C), int(f.C)])

a = json.dumps({"v": verts, "f": face_list})
# ---------- end python ----------

# ----
divide_2 = DivideCurve(Curve=explode.Segments, Count=number_slider_2, Kinks=False)  # -> simplify(Points), Tangents, Parameters
multiplication = Multiplication(A=addition_2, B=3)
partition = PartitionList(List=flatten(divide_2.Points), Size=multiplication)
cullpt = CullDuplicates(Points=partition, Tolerance=0.1, CullMode=3)  # -> Points, Indices, Valence
flatten = FlattenTree(Tree=area.Centroid, Path="{0}")

# ---- group: RH_IN:Bumpout
number_slider_3 = Slider(10, range=0..10)

# ----
vec2pt_2 = Vector2Pt(PointA=center_of_bulbpt, PointB=flatten, Unitize=False)  # -> Vector, Length
multiplication_2 = Multiplication(A=number_slider_3, B=0.01)
subtraction = Subtraction(A=400, B=vec2pt_2.Length)
multiplication_3 = Multiplication(A=subtraction, B=multiplication_2)
nurbs = NurbsCurve(Vertices=cullpt.Points, Degree=3, Periodic=True)  # -> simplify(Curve), Length, Domain
amp = Amplitude(Vector=vec2pt_2.Vector, Amplitude=multiplication_3)
move_2 = Move(Geometry=flatten, Motion=amp)  # -> graft(Geometry), Transform
patch = Patch(Curves=nurbs.Curve, Points=move_2.Geometry, Spans=20, Flexibility=20, Trim=True)
mp = MultiPipe(Curves=nurbs.Curve, NodeSize=5.131, EndOffset=1, StrutSize=0.457, Segment=0, KinkAngle=0.6, CubeFit=0, Caps=0)
join = BrepJoin(Breps=flatten([mp, patch]))  # -> Breps, Closed
mesh_2 = MeshBrep(
    Brep=join.Breps,
    Settings={GridMaxCount=0, GridMinCount=16, JaggedSeams=False, MaxEdgeLength=0, MinEdgeLength=0.0001, MinTolerance=0, Refine=True, RefineAngle=0, RelativeTolerance=0.65, SimplePlanes=True, Tolerance=0})
reduce_mesh = ReduceMesh(Mesh=mesh_2, PolygonCount=250, Distortion=True, Accuracy=8, Normalize=True, Unweld=True, Explode=False, Angle=12)
mjoin_2 = MeshJoin(Meshes=reduce_mesh)

# ---- group: RH_OUT:Mesh_Leafs
python_2 = GhPythonScript(x=mjoin_2)  # -> out, a; inputs x: Mesh; same code as python
