# Grasshopper definition Pangolin Pendant Rough Dim 2.gh (Grasshopper 1.0.7)
# plug-ins: LunchBox

gap = Slider(2, range=0..3)
center_of_bulbpt = Point(Point(0, 0, 0))
height = Slider(15, range=10..18)
diameter = Slider(20, range=0..24)
flip_direction = BooleanToggle(True)
Z = UnitZ(Factor=-46)
in_to_mm = Multiplication(A=gap, B=25.4)
in_to_mm_2 = Multiplication(A=height, B=25.4)
in_to_mm_3 = Multiplication(A=diameter, B=25.4)
center_of_bulb_point = Move(Geometry=center_of_bulbpt, Motion=Z)  # -> Geometry, Transform
num = Number(3)
divide_by_2 = Division(A=in_to_mm_2, B=2)
divide_by_2_2 = Division(A=in_to_mm_3, B=2)
circle = CircleCNR(Center=center_of_bulb_point.Geometry, Normal=Vector(0, 0, 1), Radius=divide_by_2_2)
len = Length(Curve=circle)
division = Division(A=len, B=180)
expression = Expression(x=division, y=num, Expression="y*Round(x/y)")
division_2 = Division(A=360, B=expression)
addition = Addition(A=division_2, B=5)
rad = Radians(Degrees=addition)
rad_2 = Radians(Degrees=division_2)
height_from_center_of_light_bulb_to_conn = Slider(20, range=5..100)  # "Height from Center of Light Bulb to Connector Piece"
adjust_in = Slider(-1, range=-10..10)
Z_2 = UnitZ(Factor=divide_by_2)

diameter_of_hole_mm = Number(40)
Z_3 = UnitZ(Factor=height_from_center_of_light_bulb_to_conn)
move = Move(Geometry=center_of_bulbpt, Motion=Z_3)  # -> Geometry, Transform
divide_by_2_3 = Division(A=diameter_of_hole_mm, B=2)
circle_2 = CircleCNR(Center=move.Geometry, Normal=Vector(0, 0, 1), Radius=divide_by_2_3)

addition_thickness_of_center_to_starting = Slider(29, range=0..100)  # "Addition thickness of Center to Starting Branches"
round = Round(Number=division)  # -> Nearest, Floor, Ceiling
neg = Negative(Value=Z_2)
phi = GoldenRatio(Factor=1)
series = Series(Start=-1, Step=-1, Count=3)
series_2 = Series(Start=0, Step=rad_2, Count=expr("x", expression))
move_2 = Move(Geometry=center_of_bulb_point.Geometry, Motion=[Z_2, neg])  # -> Geometry, Transform
conv_to_mm = Multiplication(A=adjust_in, B=25.4)
pow = Power(A=phi, B=series)
Z_4 = UnitZ(Factor=conv_to_mm)
ins = InsertItems(List=reverse(pow), Item=[0, 1], Indices=[0, 3], Wrap=False)  # -> reverse(List)
move_3 = Move(Geometry=move_2.Geometry, Motion=Z_4)  # -> Geometry, Transform
item = ListItem(List=move_3.Geometry, Index=1, Wrap=True)
item_2 = ListItem(List=move_3.Geometry, Index=0, Wrap=True)
gate = StreamGate(Stream=ins, Gate=flip_direction)  # -> Target0, Target1
rev = ReverseList(List=gate.Target1)
merge = Merge(Data1=item, Data2=center_of_bulbpt, Data3=item_2)
arc = Arc(Plane=merge, Radius=divide_by_2_2, Angle=rad)  # -> Arc, Length
divide = DivideCurve(Curve=arc.Arc, Count=4, Kinks=False)  # -> Points, Tangents, Parameters
vec2pt = Vector2Pt(PointA=divide.Points, PointB=graft(merge), Unitize=False)  # -> Vector, Length
line = LineSDL(Start=divide.Points, Direction=vec2pt.Vector, Length=in_to_mm)
eval = EvaluateCurve(Curve=line, Parameter=[gate.Target0, rev])  # -> Point, Tangent, Angle
viewer = ParamViewer(eval.Point)
addition_2 = Addition(A=divide_by_2_3, B=addition_thickness_of_center_to_starting)
circle_3 = CircleCNR(Center=circle_2, Normal=Vector(0, 0, 1), Radius=addition_2)
item_3 = ListItem(List=viewer, Index=0, Wrap=True)  # -> Item, Item1, Item2
loft = Loft(
    Curves=[circle_2, circle_3],
    Options={Adjust=False, Closed=False, LoftEnds=0, LoftSimp=0, LoftType=0, Rebuild=10, Refit=0.01})
branch = TreeBranch(Tree=eval.Point, Path=item_3.Item, MaintainPaths=True)
branch_2 = TreeBranch(Tree=eval.Point, Path=item_3.Item2, MaintainPaths=True)
branch_3 = TreeBranch(Tree=eval.Point, Path=item_3.Item1, MaintainPaths=True)
divide_2 = DivideCurve(Curve=circle_3, Count=6, Kinks=False)  # -> Points, Tangents, Parameters
Z_5 = UnitZ(Factor=[-2, 2])
extr = Extrude(Base=loft, Direction=Z_5)
repeat = RepeatData(Data=10, Length=3)
repeat_2 = RepeatData(Data=5, Length=3)
weave = Weave(Pattern=[0, 1], Stream0=repeat_2, Stream1=repeat, NullGaps=False)
scale = Scale(Geometry=branch, Center=item, Factor=Slider(0.843, range=0..1))  # -> Geometry, Transform
scale_2 = Scale(Geometry=branch_2, Center=item_2, Factor=Slider(0.445, range=0..1))  # -> Geometry, Transform
scale_3 = Scale(Geometry=branch_3, Center=item_2, Factor=Slider(1, range=0..1))  # -> Geometry, Transform
cull = CullPattern(List=divide_2.Points, CullPattern=invert([True, False]))
vpipe = PipeVariable(Curve=circle_3, Parameters=flatten(divide_2.Parameters), Radii=weave, Caps=0)
arc_2 = Arc3Pt(PointA=scale_2.Geometry, PointB=scale_3.Geometry, PointC=scale.Geometry)  # -> Arc, Plane, Radius
intcrv = Interpolate(Vertices=[scale.Geometry, branch_3, scale_2.Geometry], Degree=3, Periodic=False, KnotStyle=1)  # -> Curve, Length, Domain
sunion = SolidUnion(Breps=flatten([extr, vpipe]))
loft_2 = Loft(Curves=arc_2.Arc, Options={Adjust=False, Closed=False, LoftEnds=0, LoftSimp=0, LoftType=0, Rebuild=10, Refit=0.01})
number_slider = Slider(5, range=0..20)
trib = TrianglePanelsB(Surface=loft_2, UDivisions=1, VDivisions=number_slider)  # -> simplify(graft(Panels))
num_2 = Number(0)
cull_i = CullIndex(List=flatten(trib), Indices=[num_2, number_slider], Wrap=True)  # -> graft(List)
edges = BrepEdges(Brep=cull_i)  # -> Naked, Interior, NonManifold
rotate = Rotate(Geometry=cull_i, Angle=series_2, Plane=PlaneXY(0, 0, 0))  # -> simplify(Geometry), Transform
len_2 = Length(Curve=edges.Naked)  # -> flatten(Length)
sort = SortList(Keys=len_2)  # -> Keys, ValuesA
rev_2 = ReverseList(List=sort.Keys)
item_4 = ListItem(List=rev_2, Index=0, Wrap=True)
smaller = SmallerThan(FirstNumber=item_4, SecondNumber=205)  # -> SmallerThan, OrEqualTo
rh_out_geometry = Mesh(rotate.Geometry)
