# Grasshopper definition Pangolin Pendant Rough Dimension Cylinder.gh (Grasshopper 1.0.7)

# ---- group: RH_IN:Height
height = Slider(10, range=10..18)

# ---- group: RH_IN: TPDIA
top_diameter = Slider(0.629, range=0..1)

# ---- group: RH_IN:BTMDIA
bottom_diameter = Slider(1, range=0..1)

# ---- group: RH_IN:Diameter
diameter = Slider(16, range=0..24)

# ----
center_of_bulbpt = Point(Point(0, 0, 0))
in_to_mm = Multiplication(A=height, B=25.4)
in_to_mm_2 = Multiplication(A=diameter, B=25.4)
divide_by_2 = Division(A=in_to_mm, B=2)
divide_by_2_2 = Division(A=in_to_mm_2, B=2)
Z = UnitZ(Factor=divide_by_2)
neg = Negative(Value=Z)
move = Move(Geometry=center_of_bulbpt, Motion=[Z, neg])  # -> Geometry, Transform
item = ListItem(List=move.Geometry, Index=0, Wrap=True)
item_2 = ListItem(List=move.Geometry, Index=1, Wrap=True)
merge = Merge(Data1=item, Data2=center_of_bulbpt, Data3=item_2)
circle = CircleCNR(Center=merge, Normal=Vector(0, 0, 1), Radius=divide_by_2_2)
item_3 = ListItem(List=circle, Index=0, Wrap=True)  # -> Item, Item1, Item2
scale = Scale(Geometry=item_3.Item2, Center=item_2, Factor=bottom_diameter)  # -> Geometry, Transform
scale_2 = Scale(Geometry=item_3.Item, Center=item, Factor=top_diameter)  # -> Geometry, Transform
scale_3 = Scale(Geometry=item_3.Item1, Center=item, Factor=1)  # -> Geometry, Transform
loft = Loft(
    Curves=[scale_2.Geometry, scale_3.Geometry, scale.Geometry],
    Options={Adjust=False, Closed=False, LoftEnds=0, LoftSimp=0, LoftType=0, Rebuild=10, Refit=0.01})
mesh = MeshBrep(
    Brep=loft,
    Settings={GridMaxCount=0, GridMinCount=16, JaggedSeams=False, MaxEdgeLength=0, MinEdgeLength=0.0001, MinTolerance=0, Refine=True, RefineAngle=0, RelativeTolerance=0.65, SimplePlanes=True, Tolerance=0})

# ---- group: RH_OUT:Mesh_Cylinder
python = GhPythonScript(x=mesh)  # -> out, a; inputs x: Mesh
# ---------- python: Python ----------
import json
import Rhino.Geometry as rg

mesh = x

verts = []
for v in mesh.Vertices:
    verts.append([float(v.X), float(v.Y), float(v.Z)])

face_list = []
for f in mesh.Faces:
    if f.IsQuad:
        face_list.append([int(f.A), int(f.B), int(f.C), int(f.D)])
    else:
        face_list.append([int(f.A), int(f.B), int(f.C), int(f.C)])

a = json.dumps({"v": verts, "f": face_list})
# ---------- end python ----------
